# Grasshopper definition dump_compute_request7.ghx (Grasshopper 1.0.7)
# Script example

geo = Geometry([<brep
                                                                 referenced from the Rhino model> x2])
mesh = Mesh(geo)
mjoin = MeshJoin(Meshes=mesh)
encoder = GhPythonScript(inside=mjoin, x=Toggle(False))  # -> out, b; inputs x: Boolean
# ---------- encoder: Python ----------
import
                                            rhinoscriptsyntax as rs
                                            import ghpythonlib.components as gh
                                            import Rhino.Geometry as rg
                                            import json, ast
                                            import bz2, gzip
                                            import base64
                                            class Namespace:

                                            def __init__(self, **kwargs):
                                            self.keys,self.values= list(kwargs.keys()),list(kwargs.values())
                                            def asdict(self):
                                            return dict(zip(self.keys, self.values))

                                            def items(self):
                                            return zip(self.keys, self.values)

                                            def __getitem__(self, k):
                                            return self.values[self.keys.index(k)]

                                            def gh_getitem(self, k):
                                            return self.values[self.keys.index(k)]

                                            def __repr__(self):
                                            return self.__class__.__name__ + "(" + pprint.pformat(dict(zip(self.keys,
                                            self.values))) + ")"

                                            def __str__(self):
                                            return self.__class__.__name__ + "(" + pprint.pformat(dict(zip(self.keys,
                                            self.values))) + ")"

                                            def ToString(self):
                                            return self.__str__()

                                            class NamespaceComponent(object):
                                            def __new__(cls, ghenv, glbs):
                                            item_ = object.__new__(cls)

                                            item_.keys = [inp.Name for inp in ghenv.Params.Input]
                                            item_.values = []
                                            for k in item_.keys:
                                            item_.values.append(glbs.get(k))
                                            return Namespace(**dict(zip(item_.keys, item_.values)))


                                            def encode(geoms):
                                            if isinstance(geoms, list):
                                            return [encode(geom) for geom in geoms]
                                            elif isinstance(geoms, rg.Point3d):
                                            return {"X":geoms.X,"Y":geoms.Y,"Z":geoms.Z}
                                            elif isinstance(geoms, dict):
                                            return dict([(k,encode(v)) for k,v in geoms.items()])
                                            elif geoms.__class__.__name__== 'Namespace':
                                            return dict([(k,encode(v)) for k,v in geoms.asdict().items()])
                                            elif hasattr(geoms, "ToJSON"):
                                            return ast.literal_eval(geoms.ToJSON(None))
                                            elif isinstance(geoms, (int,float,bool,bytes,str)):
                                            return geoms
                                            elif hasattr(geoms, "ToNurbsCurve"):
                                            return ast.literal_eval(geoms.ToNurbsCurve().ToJSON(None))
                                            else:
                                            raise TypeError("Can not encode this :( {}".format(geoms))


                                            def compress(data):
                                            return
                                            base64.b16encode(bz2.compress(json.dumps(encode(data)),compresslevel=9)).decode()
                                            b=compress(inside)
                                            if x:

                                            with open("/Users/andrewastakhov/Library/Application
                                            Support/JetBrains/PyCharm2022.3/scratches/compute_data/request{}.json".format(id(b)),
                                            "w") as f:
                                            json.dump(
                                            {
                                            "pointer": "c:/users/administrator/compute-deploy/matchl2-deploy.gh",
                                            "values": [
                                            {
                                            "ParamName": "part",
                                            "InnerTree": {
                                            "0": [
                                            {
                                            "type": "System.String",
                                            "data": "L2"
                                            }
                                            ]
                                            }
                                            },


                                            {
                                            "ParamName": "mask",
                                            "InnerTree": {
                                            "0": [
                                            {
                                            "type": "System.String",
                                            "data": b
                                            }
                                            ]
                                            }
                                            }
                                            ]
                                            },
                                            f
                                            )
# ---------- end encoder ----------
encoder_2 = GhPythonScript(inside=mesh, x=Toggle(False))  # -> out, b; inputs inside: list, x: Boolean; same code as encoder
encoder_3 = GhPythonScript(inside=geo, x=Toggle(False))  # -> out, b; inputs inside: list, x: Boolean; same code as encoder
