# Grasshopper definition matchl2-deploy.ghx (Grasshopper 1.0.7)

# ---- group: RH_IN:part
part = Text("""L2
                                                                """)

# ---- group: RH_IN:mask
mask = Text()

# ----
decoder = GhPythonScript(mask=mask)  # -> out, b
# ---------- decoder: Python ----------
import
                                            rhinoscriptsyntax as rs
                                            import ghpythonlib.components as gh
                                            import ghpythonlib.treehelpers as th

                                            import Rhino.Geometry as rg
                                            import json, ast
                                            import bz2, base64
                                            def decode(dct):
                                            if isinstance(dct, list):
                                            return [decode(geom) for geom in dct]
                                            elif isinstance(dct, dict):
                                            if "archive3dm" in dct.keys():
                                            dct["archive3dm"]=70
                                            return rg.GeometryBase.FromJSON(json.dumps(dct))
                                            else:
                                            return dict([(k,decode(v)) for k,v in dct.items()])
                                            elif isinstance(dct, (int,float,bool,bytes,str)):
                                            return dct
                                            else:
                                            return dct

                                            #a=decode(json.loads(x))
                                            def decompress(string):
                                            return
                                            decode(json.loads(bz2.decompress(base64.b16decode(string.encode())).decode()))
                                            if _mask:
                                            b=decompress(_mask)
# ---------- end decoder ----------
gridtest = Text("""                                                                    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
                                                                """)
decoder_2 = GhPythonScript(y=gridtest)  # -> out, b
# ---------- decoder_2: Python ----------
import
                                            rhinoscriptsyntax as rs
                                            import ghpythonlib.components as gh
                                            import ghpythonlib.treehelpers as th

                                            import Rhino.Geometry as rg
                                            import json, ast
                                            import bz2, base64
                                            def decode(dct):
                                            if isinstance(dct, list):
                                            return [decode(geom) for geom in dct]
                                            elif isinstance(dct, dict):
                                            if "archive3dm" in dct.keys():
                                            dct["archive3dm"]=70
                                            return rg.GeometryBase.FromJSON(json.dumps(dct))
                                            else:
                                            return dict([(k,decode(v)) for k,v in dct.items()])
                                            elif isinstance(dct, (int,float,bool,bytes,str)):
                                            return dct
                                            else:
                                            return dct

                                            #a=decode(json.loads(x))
                                            def decompress(string):
                                            return
                                            decode(json.loads(bz2.decompress(base64.b16decode(string.encode())).decode()))

                                            b=th.list_to_tree(decompress(y))
# ---------- end decoder_2 ----------
types = Text("""                                                                    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
                                                                """)
decoder_3 = GhPythonScript(y=types, x=part)  # -> out, lset, labels, points
# ---------- decoder_3: Python ----------
import
                                            rhinoscriptsyntax as rs
                                            import ghpythonlib.components as gh
                                            import ghpythonlib.treehelpers as th

                                            import Rhino.Geometry as rg
                                            import json, ast
                                            import bz2, base64
                                            def decode(dct):
                                            if isinstance(dct, list):
                                            return [decode(geom) for geom in dct]
                                            elif isinstance(dct, dict):
                                            if "archive3dm" in dct.keys():
                                            dct["archive3dm"]=70
                                            return rg.GeometryBase.FromJSON(json.dumps(dct))
                                            else:
                                            return dict((k,decode(v)) for k,v in dct.items())
                                            elif isinstance(dct, (int,float,bool,bytes,str)):
                                            return dct
                                            else:
                                            return dct

                                            #a=decode(json.loads(x))
                                            def decompress(string):
                                            return
                                            decode(json.loads(bz2.decompress(base64.b16decode(string.encode())).decode()))
                                            import rhinoscriptsyntax as rs
                                            import json,ast
                                            import rhinoscriptsyntax as rs
                                            import ghpythonlib.treehelpers as th
                                            import Rhino.Geometry as rg
                                            labels=[]
                                            points=[]
                                            #with
                                            open("/Users/andrewastakhov/PycharmProjects/mmodel/dumps/{}.json".format(y),
                                            "r") as f:
                                            data=decompress(y)

                                            #print data.keys()[0]
                                            def encode_types(data):
                                            labels=[]
                                            points=[]

                                            for k in data:
                                            kk, vv=k
                                            try:
                                            if vv[0]=="H1":
                                            vv[0]="H"
                                            elif vv[0]=="H2":
                                            vv[0]="T"
                                            else:
                                            pass
                                            labels.append(vv[0]), points.append(rg.Point3d(*kk))
                                            except:
                                            pass
                                            lset=set(labels)
                                            return labels, points, lset
                                            labels, points, lset=encode_types(data[x])
# ---------- end decoder_3 ----------
lng = ListLength(List=decoder_3.lset)
range = Range(Domain=Domain(0, 1), Steps=lng)
gradient = Gradient(
    LowerLimit=0,
    UpperLimit=1,
    Parameter=range,
    stops=[0: RGB(243, 57, 0), 0.1: RGB(236, 27, 60), 0.2: RGB(210, 0, 118), 0.3: RGB(103, 0, 120), 0.4: RGB(39, 72, 161), 0.5: RGB(1, 192, 229), 0.6: RGB(18, 178, 90), 0.7: RGB(79, 186, 8), 0.8: RGB(220, 237, 32), 0.9: RGB(247, 159, 20), 1: RGB(243, 57, 0)])
centroid = GhPythonScript(x=decoder_2.b)  # -> out, a; inputs x: tree of Curve
# ---------- centroid: Python ----------
"""Provides a
                                            scripting component.
                                            Inputs:
                                            x: The x script variable
                                            y: The y script variable
                                            Output:
                                            a: The a output variable"""

                                            __author__ = "andrewastakhov"

                                            import rhinoscriptsyntax as rs
                                            import json,ast
                                            import rhinoscriptsyntax as rs
                                            import ghpythonlib.treehelpers as th
                                            import Rhino.Geometry as rg
                                            def gen_sheet3(x):
                                            tt=th.tree_to_list(x)
                                            for i, xx, in enumerate(tt):
                                            ##print i,xx
                                            for j, yy, in enumerate(xx):
                                            p=rg.AreaMassProperties.Compute(tt[i][j])

                                            yield p.Centroid
                                            a=list(gen_sheet3(x))
                                            #with
                                            open("/Users/andrewastakhov/PycharmProjects/mmodel/tests/{}-centroid.json".format(y),
                                            "w") as f:

                                            #json.dump([[aa.X,aa.Y,aa.Z] for aa in a], f)
# ---------- end centroid ----------

project = Project(Geometry=decoder_3.points, Plane=PlaneXY(0, 0, 0))  # -> Geometry, Transform
project_2 = Project(Geometry=centroid.a, Plane=PlaneXY(0, 0, 0))  # -> Geometry, Transform
cp = ClosestPoint(Point=project.Geometry, Cloud=project_2.Geometry)  # -> ClosestPoint, CPIndex, Distance
lng_2 = ListLength(List=project_2.Geometry)
python = GhPythonScript(x=cp.Distance, y=decoder_3.labels, z=lng_2, u=cp.CPIndex)  # -> out, a; inputs x: list, y: list, u: list
# ---------- python: Python ----------
"""Provides a
                                            scripting component.
                                            Inputs:
                                            x: The x script variable
                                            y: The y script variable
                                            Output:
                                            a: The a output variable"""

                                            __author__ = "andrewastakhov"

                                            import rhinoscriptsyntax as rs
                                            import itertools

                                            l=list(itertools.repeat("A", z))

                                            for xx, ii,yy in zip(x,u, y):
                                            if xx<200:
                                            l[ii] = yy
                                            a=l
                                            #print(set(l))
# ---------- end python ----------

col = Colour(gradient)
python_2 = GhPythonScript(x=col)  # -> out, a
# ---------- python_2: Python ----------
"""Provides a
                                            scripting component.
                                            Inputs:
                                            x: The x script variable
                                            y: The y script variable
                                            Output:
                                            a: The a output variable"""

                                            __author__ = "andrewastakhov"

                                            import rhinoscriptsyntax as rs

                                            a=repr(tuple(x))
# ---------- end python_2 ----------
python_3 = GhPythonScript(x=decoder_3.lset, y=python_2.a)  # -> out, a, b; inputs x: list, y: list
# ---------- python_3: Python ----------
"""Provides a
                                            scripting component.
                                            Inputs:
                                            x: The x script variable
                                            y: The y script variable
                                            Output:
                                            a: The a output variable"""

                                            __author__ = "andrewastakhov"

                                            import rhinoscriptsyntax as rs
                                            class Strongdict:
                                            def __init__(self,x,y):

                                            self.a=dict(zip(x,y))
                                            def getk(self,k):
                                            return self.a[k]
                                            def getmany(self,kk):
                                            for k in kk:
                                            yield self.getk(k)

                                            a=Strongdict(x+["A"],y+['(50,50,50)'])
# ---------- end python_3 ----------

python_4 = GhPythonScript(x=decoder_2.b)  # -> out, a; inputs x: tree
# ---------- python_4: Python ----------
"""Provides a
                                            scripting component.
                                            Inputs:
                                            x: The x script variable
                                            y: The y script variable
                                            Output:
                                            a: The a output variable"""

                                            __author__ = "andrewastakhov"

                                            import rhinoscriptsyntax as rs
                                            import json,ast
                                            import rhinoscriptsyntax as rs
                                            import ghpythonlib.treehelpers as th
                                            def gen_sheet3(x, s=("1","2")):

                                            for i, xx, in enumerate(th.tree_to_list(x)):
                                            ##print i,xx
                                            for j, yy, in enumerate(xx):
                                            u=i%2 == 0
                                            v=j%2 == 0

                                            #if (u,v) == (True ,True):
                                            # yield s[0]
                                            #elif (u,v) == (True ,False):
                                            # yield s[1]
                                            #elif (u,v) == (False ,True):
                                            # yield s[1]
                                            #elif (u,v) == (False ,False):
                                            # yield s[0]
                                            if u == v:
                                            yield s[0]
                                            else:
                                            yield s[1]


                                            a=list(gen_sheet3(x))
                                            #with
                                            open("/Users/andrewastakhov/PycharmProjects/mmodel/tests/{}-subtype.json".format(y),
                                            "w") as f:
                                            # json.dump(a, f)
# ---------- end python_4 ----------
centroid_2 = GhPythonScript(x=decoder_2.b)  # -> out, a, b; inputs x: tree of Curve
# ---------- centroid_2: Python ----------
"""Provides a
                                            scripting component.
                                            Inputs:
                                            x: The x script variable
                                            y: The y script variable
                                            Output:
                                            a: The a output variable"""

                                            __author__ = "andrewastakhov"

                                            import rhinoscriptsyntax as rs
                                            import json,ast
                                            import rhinoscriptsyntax as rs
                                            import ghpythonlib.treehelpers as th
                                            import Rhino.Geometry as rg
                                            def gen_sheet3(x):
                                            tt=th.tree_to_list(x)
                                            for i, xx, in enumerate(tt):
                                            ##print i,xx
                                            for j, yy, in enumerate(xx):
                                            p=rg.AreaMassProperties.Compute(tt[i][j])

                                            yield p.Centroid
                                            def gen_sheet4(x):
                                            tt=th.tree_to_list(x)
                                            for i, xx, in enumerate(tt):
                                            ##print i,xx
                                            for j, yy, in enumerate(xx):
                                            p=rg.AreaMassProperties.Compute(tt[i][j])

                                            yield p.Area
                                            a=list(gen_sheet3(x))
                                            b=list(gen_sheet4(x))
                                            #with
                                            open("/Users/andrewastakhov/PycharmProjects/mmodel/tests/{}-centroid.json".format(y),
                                            "w") as f:

                                            #json.dump([[aa.X,aa.Y,aa.Z] for aa in a], f)
# ---------- end centroid_2 ----------

python_5 = GhPythonScript(x=python_3.a, y=python.a)  # -> out, a, b; inputs y: list
# ---------- python_5: Python ----------
"""Provides a
                                            scripting component.
                                            Inputs:
                                            x: The x script variable
                                            y: The y script variable
                                            Output:
                                            a: The a output variable"""

                                            __author__ = "andrewastakhov"

                                            import rhinoscriptsyntax as rs


                                            b=list(x.getmany(y))
# ---------- end python_5 ----------

python_6 = GhPythonScript()  # -> TrianglePanel
# ---------- python_6: Python ----------
"""Provides a
                                            scripting component.
                                            Inputs:
                                            x: The x script variable
                                            y: The y script variable
                                            Output:
                                            a: The a output variable"""

                                            __author__ = "Administrator"
                                            __version__ = "2022.12.12"

                                            import rhinoscriptsyntax as rs
                                            import Rhino.Geometry as rg
                                            import Rhino
                                            import ast, json
                                            from json import JSONDecoder, JSONEncoder

                                            from collections import namedtuple
                                            TrianglePanel= namedtuple("TrianglePanel",["tag","type", "subtype","area",
                                            "center","color","matrix"])
# ---------- end python_6 ----------
python_7 = GhPythonScript(x=python_6, dtype=python.a, subtype=python_4.a, centroid=centroid_2.a, area=centroid_2.b, colors=python_5.b)  # -> out, a
# ---------- python_7: Python ----------
"""Provides a
                                            scripting component.
                                            Inputs:
                                            x: The x script variable
                                            y: The y script variable
                                            Output:
                                            a: The a output variable"""

                                            __author__ = "Administrator"
                                            __version__ = "2022.12.12"
                                            import ast, json
                                            import rhinoscriptsyntax as rs
                                            class Cont:
                                            def __init__(self, cl):
                                            self._cl=cl
                                            def GetString(self):
                                            return self._cl.__repr__()

                                            a=Cont(x(
                                            dtype+"-"+subtype,
                                            dtype,
                                            subtype,
                                            area,
                                            centroid ,
                                            colors,
                                            matrix = [1, 0, 0, centroid.X, 0, 1, 0, centroid.Y, 0, 0, 1, centroid.Z, 0,
                                            0, 0, 1]
                                            )
                                            )
# ---------- end python_7 ----------

offset_l = OffsetCurveLoose(Curve=decoder_2.b, Distance=-1.5)

python_8 = GhPythonScript(x=flatten(offset_l), y=decoder.b)  # -> out, ans; inputs x: list of Curve, y: list of Mesh
# ---------- python_8: Python ----------
import
                                            Rhino.Geometry as rg
                                            import json
                                            def check(x, y, eps=50.0):
                                            x.Transform(rg.Transform.PlanarProjection(rg.Plane.WorldXY))
                                            [yy.Transform(rg.Transform.PlanarProjection(rg.Plane.WorldXY)) for yy in y]
                                            ap=rg.AreaMassProperties.Compute(x)
                                            dst=list(map(lambda yy: (yy,
                                            ap.Centroid.DistanceTo(yy.ClosestPoint(ap.Centroid))), y))
                                            dst.sort(key=lambda xx: xx[1])
                                            if dst[0][1]<eps:
                                            return all(
                                            [(not rg.Curve.PlanarCurveCollision(x, crv.ToNurbsCurve() ,
                                            rg.Plane.WorldXY, 0.1)) for crv in
                                            list(dst[0][0].GetOutlines(rg.Plane.WorldXY))
                                            ])
                                            else:
                                            return False

                                            def main_func(aa,bb,eps=50.0):
                                            for aaa in aa:
                                            yield check(aaa, bb, eps=eps)
                                            if y[0]:
                                            ans=list(main_func(x,y, eps=40))
# ---------- end python_8 ----------

smesh = SimpleMesh(Brep=decoder_2.b)
cull = CullPattern(List=flatten(smesh), CullPattern=python_8.ans)
cull_2 = CullPattern(List=flatten(python_7.a), CullPattern=python_8.ans)
python_9 = GhPythonScript(x=cull_2)  # -> out, a; inputs x: list
# ---------- python_9: Python ----------
"""Provides a
                                            scripting component.
                                            Inputs:
                                            x: The x script variable
                                            y: The y script variable
                                            Output:
                                            a: The a output variable"""

                                            __author__ = "Administrator"
                                            __version__ = "2022.12.12"

                                            import rhinoscriptsyntax as rs
                                            import json
                                            l=[]
                                            for xx in x:

                                            l.append(xx._cl._asdict())
                                            a=l
# ---------- end python_9 ----------
encoder = GhPythonScript(inside=python_9.a)  # -> out, b; inputs inside: list
# ---------- encoder: Python ----------
import
                                            rhinoscriptsyntax as rs
                                            import ghpythonlib.components as gh
                                            import Rhino.Geometry as rg
                                            import json, ast
                                            import bz2, gzip
                                            import base64
                                            class Namespace:

                                            def __init__(self, **kwargs):
                                            self.keys,self.values= list(kwargs.keys()),list(kwargs.values())
                                            def asdict(self):
                                            return dict(zip(self.keys, self.values))

                                            def items(self):
                                            return zip(self.keys, self.values)

                                            def __getitem__(self, k):
                                            return self.values[self.keys.index(k)]

                                            def gh_getitem(self, k):
                                            return self.values[self.keys.index(k)]

                                            def __repr__(self):
                                            return self.__class__.__name__ + "(" + pprint.pformat(dict(zip(self.keys,
                                            self.values))) + ")"

                                            def __str__(self):
                                            return self.__class__.__name__ + "(" + pprint.pformat(dict(zip(self.keys,
                                            self.values))) + ")"

                                            def ToString(self):
                                            return self.__str__()

                                            class NamespaceComponent(object):
                                            def __new__(cls, ghenv, glbs):
                                            item_ = object.__new__(cls)

                                            item_.keys = [inp.Name for inp in ghenv.Params.Input]
                                            item_.values = []
                                            for k in item_.keys:
                                            item_.values.append(glbs.get(k))
                                            return Namespace(**dict(zip(item_.keys, item_.values)))


                                            def encode(geoms):
                                            if isinstance(geoms, list):
                                            return [encode(geom) for geom in geoms]
                                            elif isinstance(geoms, rg.Point3d):
                                            return {"X":geoms.X,"Y":geoms.Y,"Z":geoms.Z}
                                            elif isinstance(geoms, dict):
                                            return dict([(k,encode(v)) for k,v in geoms.items()])
                                            elif geoms.__class__.__name__== 'Namespace':
                                            return dict([(k,encode(v)) for k,v in geoms.asdict().items()])
                                            elif hasattr(geoms, "ToJSON"):
                                            return ast.literal_eval(geoms.ToJSON(None))
                                            elif isinstance(geoms, (int,float,bool,bytes,str)):
                                            return geoms
                                            elif hasattr(geoms, "ToNurbsCurve"):
                                            return ast.literal_eval(geoms.ToNurbsCurve().ToJSON(None))
                                            else:
                                            raise TypeError("Can not encode this :( {}".format(geoms))


                                            def compress(data):
                                            return
                                            base64.b16encode(bz2.compress(json.dumps(encode(data)),compresslevel=9)).decode()

                                            b=compress(inside)
# ---------- end encoder ----------

# ---- group: RH_OUT:output
output = Text(encoder.b)
